# Grasshopper definition test_model.gh (Grasshopper 1.0.8)

box_2pt = Box2Pt(PointA="0,0,0", PointB="10,20,3", Plane=PlaneXY(0, 0, 0))
box_2pt_2 = Box2Pt(PointA="0,0,3", PointB="10,10,6", Plane=PlaneXY(0, 0, 0))
brep = Brep(box_2pt)
brep_2 = Brep(box_2pt_2)
intsolid = HBIntersectSolids(rooms=flatten([brep, brep_2]), run=Toggle(True))  # -> int_rooms; plug-in component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
roomsolid = HBRoomFromSolid(geo=flatten(intsolid), conditioned=True)  # -> out, rooms; plug-in component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
solveadj = HBSolveAdjacency(rooms=flatten(roomsolid.rooms), run=Toggle(True))  # -> out, adj_rooms; plug-in component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
model = HBModel(rooms=flatten(solveadj.adj_rooms), name="This is a Test Model")  # -> out, model; plug-in component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
file_path = FilePath("/Users/em/Dropbox/bldgtyp-00/00_PH_Tools/ph_navigator/backend/")
dumpobjects = HBDumpObjects(hb_objs=flatten(model.model), name="test_model", folder=file_path, dump=Toggle(False))  # -> out, hb_file; plug-in component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
